vi "Main.gviweb"   [LabVIEW NXG 3.0.0]
panel controls:
  "Button": bool
  "rx message": string
  "Button_2": bool
panel indicators:
  "messages": string
  "loop iteration": i32
  "loop iteration_2": i32
  "tx messages": string
  "loop iteration_3": i32
uses:
  WebApp::Web Bluetooth UART.jsli::Read TX Message
  WebApp::Web Bluetooth UART.jsli::Read Log Message
  WebApp::Web Bluetooth UART.jsli::Select Button And Wait For Device
  WebApp::Web Bluetooth UART.jsli::Send RX Message
  WebApp::Web Bluetooth UART.jsli::Close Device
diagram:
  # Note: Added scripts.js manually in the HTML tab. Required for any Top-Level VI that uses the Web Bluetooth UART JSLI Nodes
  s1 = ""  # shift register
  while (iteration -> i1) {
    call "Read TX Message"() -> (return=w1, error out=w2)
    Concatenate Strings(w1, "\n", s1) -> w3
    $"tx messages" <- w3
    $"loop iteration_2" <- i1
    next s1 = w3
    stop if w2
  }
  # Note: Do good error handling! WebVIs do not have automatic error reporting so easy to miss errors.
  s2 = ""  # shift register
  while (iteration -> i2) {
    call "Read Log Message"() -> (return=w4, error out=w5)
    Concatenate Strings(w4, "\n", s2) -> w6
    $messages <- w6
    $"loop iteration" <- i2
    next s2 = w6
    stop if w5
  }
  while (iteration -> i3) {
    # CSS Selector string found in right rail after selecting button
    call "Select Button And Wait For Device"(button selector="jqx-toggle-button[ni-control-id='46']") -> (return=w7, error out=w8)
    case (w7) {
      frame False, Default {
        w10 = no error  # Error
        w9 = w10
      }
      frame True {
        # might want to do this in a loop or something
        while {
          event {
            on "Button_2" Value changed {
              call "Send RX Message"(rx message=$"rx message", error in=w8)
            }
          }
          stop if FALSE
        }
        w11 = no error  # Error
        w9 = w11
      }
    }
    call "Close Device"(error in=w9)
    Wait(time to wait=1000)
    $"loop iteration_3" <- i3
    stop if FALSE
  }
